vi "Efficiency.gviweb"   [LabVIEW NXG 3.1.0]
panel indicators:
  "Chart": f64
  "banner": string
diagram:
  while {
    Random Number() -> (number (0 to 1)=w1)
    Multiply(w1, 100) -> w2
    $Chart <- w2
    Wait(time to wait=500)
    stop if FALSE
  }
