vi "advanced.gviweb"   [LabVIEW NXG 3.1.0]
panel controls:
  "Tree": cluster{"Path": string}[] = [{"Path"="Lab 1\\Tank 14"}, {"Path"="Lab 4\\Tank 189"}]
  "Data Grid": cluster{"A": string, "String": string}[]
  "Stop": bool
  "Button": bool
  "Cluster": cluster{"Button_2": bool, "Button_3": bool}
panel indicators:
  "Pump Data": T1
  "CPU Usage": f64
  "Chart": f64[]
  "Pump Voltage": f64[]
  "Header Line 1": string
  "Pump Pressure": f64[]
  "Pump Flow": f64[]
  "Pump Speed": f64[]
  "Controller Current": f64[]
  "Pump Current": f64[]
  "Header Line 1_2": string
  "Header Line 1_3": string
  "String": string
  "Selection": string
  "index of element": i32
types:
  T1 = cluster{"Voltages": f64[], "PumpCurrent": f64[], "Speed": f64[], "ControllerCurrent": f64[], "Pressure": f64[], "Flow": f64[], "Elapsed Time (Display)": f64[], "Avg Pressure": f64, "Avg Speed": f64, "Elapsed Time": f64[]}
  T2 = cluster{"PS Actual (V):": f64, "Temp1": f64, "Temp2": f64}
  T3 = cluster{"Pump 1": bool, "Pump 2": bool, "Pump 3": bool, "Pump 4": bool, "Pump 5": bool, "Pump 6": bool}
  T4 = cluster{"Line 1": string, "Line 2": string, "Line 3": string, "Line 4": string}
  T5 = cluster{"PS CMD": f64, "Press CMD": f64, "Temp 1 CMD": f64, "Temp 2 CMD": f64}
  T6 = cluster{"Start Test": bool, "Toggle Spare 1": bool, "Toggle Spare 2": bool, "Toggle Spare 3": bool, "Toggle Spare 4": bool, "Toggle Spare 5": bool}
  T7 = cluster{"Stop": bool, "Reset Timers": bool, "Log Fuel Change": bool, "Alarm Dismiss": bool}
  T8 = cluster{"CommSeg": i32, "PWM?": bool, "Frequency": i32, "Low Command": f64, "High Command": f64, "Stop Command": f64, "Command Step": f64, "Solenoid Stop?": bool, "Controller?": bool, "Invert PWM": bool}
  T9 = cluster{"Error": error, "Pump Data": T1, "Tank Data": T2, "Power Relays": T3, "Pump CMDs": f64[], "HMI Header": T4, "Tank CMDs": T5, "HMI Tog Buttons": T6, "In Test": bool, "HMI Command": bool, "HMI Mom Buttons": T7, "Controller Config": T8, "Alarm": bool, "Alarm Message 1": string, "Alarm Message 2": string, "Recording": bool, "Serial Numbers": string[], "Pumps Present": bool[], "CPU Usage": f64}
uses:
  NI::HTTP::GET.gvi
diagram:
  Property Node(instance in=reference to "Tree", "ColumnHeaders"=["System"])
  w1 = [{"Path"="Lab 1\\Tank 1"}, {"Path"="Lab 1\\Tank 2"}, {"Path"="Lab 1\\Tank 3"}, {"Path"="Lab 1\\Tank 4"}, {"Path"="Lab 1\\Tank 5"}, {"Path"="Lab 1\\Tank 6"}, {"Path"="Lab 1\\Tank 7"}, {"Path"="Lab 1\\Tank 8"}, {"Path"="Lab 1\\Tank 9"}, {"Path"="Lab 1\\Tank 10"}, {"Path"="Lab 1\\Tank 12"}, {"Path"="Lab 1\\Tank 14"}, {"Path"="Lab 1\\Tank 16"}, {"Path"="Lab 1\\Tank 17"}, {"Path"="Lab 1\\Tank 18"}, {"Path"="Lab 1\\Tank 19"}, {"Path"="Lab 1\\Tank 20"}, {"Path"="Lab 1\\Tank 21"}, {"Path"="Lab 1\\Tank 22"}, {"Path"="Lab 1\\Tank 23"}, {"Path"="Lab 1\\Tank 24"}, {"Path"="Lab 2\\Tank 54B"}, {"Path"="Lab 3\\Tank 73-75"}, {"Path"="Lab 4\\Tank 189"}]
  Property Node(instance in=reference to "Tree", "Value"=w1) -> (error out=w2)
  while (after w2) {
    event (timeout = 1000) {
      on Timeout {
        call "GET.gvi"(url="http://10.30.189.137:8002/WebService/GetPumpData") -> (body=w3, error out=w4)
        w5 = T9 {"Pump Data"={"Elapsed Time"=[4074.9003, 4074.9003, 4074.9003, 4074.9003, 4074.9003, 4074.9003]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}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}
        Unflatten From JSON(JSON string=w3, error in (no error)=w4, type and defaults=w5) -> (value=w6)
        Property Node(instance in=w6) -> ("Pump Data"=w7, "CPU Usage"=w8, "HMI Header:Line 1"=w9, "HMI Header:Line 2"=w10, "HMI Header:Line 4"=w11, "Pump Data:Voltages"=w12, "Pump Data:Pressure"=w13, "Pump Data:Flow"=w14, "Pump Data:Speed"=w15, "Pump Data:ControllerCurrent"=w16, "Pump Data:PumpCurrent"=w17)
        $"Pump Data" <- w7
        $"CPU Usage" <- w8
        $"Header Line 1" <- w9
        $"Header Line 1_2" <- w10
        $"Header Line 1_3" <- w11
        $"Pump Voltage" <- w12
        $"Pump Pressure" <- w13
        $"Pump Flow" <- w14
        $"Pump Speed" <- w15
        $"Controller Current" <- w16
        $"Pump Current" <- w17
      }
      on "Array" Value changed {
        Event Data() -> ("Control Reference"=w18)
        Property Node(instance in=w18) -> ("Value"=w19)
        Search 1D Array(1D array=w19, element=TRUE) -> (index of element=w20)
        $"index of element" <- w20
      }
    }
    stop if FALSE
  }
