vi "basic.gviweb"   [LabVIEW NXG 3.1.0]
panel controls:
  "Hyperlink Control": string = "login.html"
panel indicators:
  "Pump Data": T1
  "error out": error
  "CPU Usage": f64
  "HMI Header:Line 1": string
types:
  T1 = cluster{"Voltages": f64[], "PumpCurrent": f64[], "Speed": f64[], "ControllerCurrent": f64[], "Pressure": f64[], "Flow": f64[], "Elapsed Time (Display)": f64[], "Avg Pressure": f64, "Avg Speed": f64, "Elapsed Time": f64[]}
  T2 = cluster{"PS Actual (V):": f64, "Temp1": f64, "Temp2": f64}
  T3 = cluster{"Pump 1": bool, "Pump 2": bool, "Pump 3": bool, "Pump 4": bool, "Pump 5": bool, "Pump 6": bool}
  T4 = cluster{"Line 1": string, "Line 2": string, "Line 3": string, "Line 4": string}
  T5 = cluster{"PS CMD": f64, "Press CMD": f64, "Temp 1 CMD": f64, "Temp 2 CMD": f64}
  T6 = cluster{"Start Test": bool, "Toggle Spare 1": bool, "Toggle Spare 2": bool, "Toggle Spare 3": bool, "Toggle Spare 4": bool, "Toggle Spare 5": bool}
  T7 = cluster{"Stop": bool, "Reset Timers": bool, "Log Fuel Change": bool, "Alarm Dismiss": bool}
  T8 = cluster{"CommSeg": i32, "PWM?": bool, "Frequency": i32, "Low Command": f64, "High Command": f64, "Stop Command": f64, "Command Step": f64, "Solenoid Stop?": bool, "Controller?": bool, "Invert PWM": bool}
  T9 = cluster{"Error": error, "Pump Data": T1, "Tank Data": T2, "Power Relays": T3, "Pump CMDs": f64[], "HMI Header": T4, "Tank CMDs": T5, "HMI Tog Buttons": T6, "In Test": bool, "HMI Command": bool, "HMI Mom Buttons": T7, "Controller Config": T8, "Alarm": bool, "Alarm Message 1": string, "Alarm Message 2": string, "Recording": bool, "Serial Numbers": string[], "Pumps Present": bool[], "CPU Usage": f64}
uses:
  NI::HTTP::GET.gvi
diagram:
  while {
    call "GET.gvi"(url="http://10.30.189.112:8001/WebService/GetPumpData") -> (body=w1, error out=w2)
    w3 = T9 {"Pump Data"={"Elapsed Time"=[4074.9003, 4074.9003, 4074.9003, 4074.9003, 4074.9003, 4074.9003]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}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}
    Unflatten From JSON(JSON string=w1, error in (no error)=w2, type and defaults=w3) -> (value=w4)
    Property Node(instance in=w4) -> ("Pump Data"=w5, "CPU Usage"=w6, "HMI Header:Line 1"=w7)
    $"Pump Data" <- w5
    $"CPU Usage" <- w6
    $"HMI Header:Line 1" <- w7
    $"error out" <- w2
    Wait(time to wait=1000)
    stop if FALSE
  }
