vi "index.gviweb"   [LabVIEW NXG 3.1.0]
panel controls:
  "pb.CustomerLogin": bool
  "pb.TechnicianLogin": bool
  "pb.EngineerLogin": bool
panel indicators:
  "URL Image": string
uses:
  Calculator Library::Redirect.jsli::Redirect
diagram:
  sequence {
    frame 0 {
      Property Node(instance in=reference to "pb.CustomerLogin", "Disabled"=TRUE) -> (instance out=w1)
      Property Node(instance in=reference to "pb.EngineerLogin", "Disabled"=TRUE)
    }
  }
  while (after w1) {
    event (timeout = 500) {
      on Timeout { }
      on "pb.TechnicianLogin" Value changed {
        call "Redirect"(URL="advanced.html")
      }
    }
    stop if FALSE
  }
